# Dynamo graph TransformData.dyn (Dynamo 2.10.1.3976)

select_model_element = DSModelElementSelection()  # 1 picked in the model
python_script = Python(IN[0]=select_model_element)  # IronPython2
# ---------- python_script.python (39 lines) ----------
import clr
clr.AddReference("RevitNodes")
import Revit
clr.ImportExtensions(Revit.Elements)
clr.AddReference("RevitAPI")
import Autodesk
from Autodesk.Revit.DB import *
clr.AddReference('DSCoreNodes')
clr.AddReference('ProtoGeometry')
clr.ImportExtensions(Revit.GeometryConversion)
from DSCore import *
clr.AddReference("RevitServices")
from RevitServices.Persistence import DocumentManager
from RevitServices.Transactions import TransactionManager
doc = DocumentManager.Instance.CurrentDBDocument
uiapp = DocumentManager.Instance.CurrentUIApplication
app = uiapp.Application

def GetAxes(transform):
	axes = []
	axes.append(transform.Origin.ToPoint())
	axes.append(transform.BasisX.ToVector())
	axes.append(transform.BasisY.ToVector())
	axes.append(transform.BasisZ.ToVector())
	return axes

wall = UnwrapElement(IN[0])
output = []

#Get wall bounding box
wallBoundBox = wall.get_BoundingBox(doc.ActiveView)

#Original
transform = wall.GetTransform()
originalTransform = wallBoundBox.Transform
originalAxes = GetAxes(originalTransform)
translation = transform.Origin

OUT = transform.BasisX, transform.BasisY, transform.BasisZ , translation
# ----------------------------------------
watch = Watch(python_script)
file_path = Filename("C:\Users\DELL\OneDrive\Desktop\panel1.txt")
exportCSV = Data.ExportCSV(filePath=file_path, data=python_script)
